# Grasshopper definition example04.ghx (Grasshopper 1.0.7)

reload = Button()
# Example 04: Load 2D planar curves
panel = Panel("example04")
py = GhPythonScript()  # -> WEB, DATA
# ---------- py: Python ----------
import sys
import os

filepath = os.path.dirname(ghenv.Component.OnPingDocument().FilePath)

LIB = os.path.join(filepath, "..", "src")
LIB = os.path.abspath(LIB)

sys.path.append(LIB)

from workshop_sjsu import DATA
from workshop_sjsu import WEB
# ---------- end py ----------

# ----
# Curve
panel_2 = Panel("1. Define planar curve/s")
crv = Curve(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)

# ----
# Boundary
# Change radius to fit the curve within the circle
panel_3 = Panel("2. Define boundary circle")
xy = XYPlane(Origin=Point(0, 0, 0))
cir = Circle(Plane=xy, Radius=Slider(2.4, range=0..100))
circle = Circle(cir)

py_2 = PythonScript(reload=reload)
# ---------- py_2: Python ----------
if reload:
    from compas_ghpython import unload_modules
    unload_modules('compas')
    unload_modules('workshop_sjsu')
    unload_modules('compas_fab')
# ---------- end py_2 ----------
name = Data(panel)
dam = DataDam(DataA=crv, BufferDelay=10000000, BufferMode=0)
number_slider = Slider(0.01, range=0..0.1)
pipe = Pipe(Curve=crv, Radius=number_slider, Caps=0)
preview = CustomPreview(Geometry=pipe, Material=ColourSwatch(SwatchColor=RGB(0, 255, 123)))
pipe_2 = Pipe(Curve=circle, Radius=number_slider, Caps=0)
preview_2 = CustomPreview(Geometry=pipe_2, Material=ColourSwatch(SwatchColor=RGB(0, 0, 0)))

# ----
# Resolution
# Define resolution of the curve, ideally not higher than 1000 points
number_slider_2 = Slider(300, range=0..400)
divide = DivideCurve(Curve=dam, Count=number_slider_2, Kinks=False)  # -> Points, Tangents, Parameters
point2d = Point(divide.Points)

# ----
# Sphere
py_3 = GhPythonScript()  # -> sphere; disabled; unedited script template
sphere = Geometry(py_3)  # disabled

number_slider_3 = Slider(1.34, range=0.3..2.5)  # disabled
swatch = ColourSwatch(SwatchColor=RGB(255, 255, 255))  # disabled
python = GhPythonScript(sphere=sphere, circle=circle, points2d=point2d, scale=number_slider_3)  # -> P, points3d; inputs sphere: Surface, points2d: list; disabled
# ---------- python: Python ----------
from workshop_sjsu.rhino.utilities import map2sphere


points3d = map2sphere(sphere, circle, points2d, scale)
# ---------- end python ----------
preview_3 = CustomPreview(Geometry=sphere, Material=swatch)  # disabled

# ----
# Map curves on sphere
# change here to scale
points3d = Point(python.points3d)  # disabled

# ----
# Gradient
# circle to check if gradient works
point2d_2 = Point(point2d)
python_2 = GhPythonScript(circle=circle, points=point2d_2)  # -> Pn; inputs points: list
# ---------- python_2: Python ----------
import Rhino.Geometry as rg

Pn = []
for point in points:
    point_new = (point + rg.Vector3d(circle.Radius, circle.Radius, 0))/(2 * circle.Radius)
    Pn.append(point_new)
# ---------- end python_2 ----------
# Create your own or look into workshop_sjsu\images for other gradients.
# ATTENTION: If you create your own, please make them the same size of 100x100 px.
image = ImageSampler(
    python_2,
    FilePath="C:\Users\rustr\workspace\teaching\workshop_sjsu\images\gradient-02.png",
    Filter="Value",
    Interpolate=False,
    Umax=1,
    Umin=0,
    Vmax=1,
    Vmin=0,
    Wrap=1)

multiplication = Multiplication(A=image, B=Slider(0.1, range=0..1))
vpipe = PipeVariable(Curve=crv, Parameters=divide.Parameters, Radii=multiplication, Caps=0)
preview_4 = CustomPreview(Geometry=vpipe, Material=ColourSwatch(SwatchColor=RGB(0, 255, 123)))
multiplication_2 = Multiplication(A=image, B=Slider(0.1, range=0..1))
gradient = Number(image)

cir_2 = Circle(Plane=point2d_2, Radius=multiplication_2)

# ----
# Export for robot
python_3 = GhPythonScript(points3d=points3d, gradients=image)  # -> data; inputs points3d: list, gradients: list; disabled
# ---------- python_3: Python ----------
data = {}
data['points'] = [[p.X, p.Y, p.Z] for p in points3d]
data['values'] = list(gradients)

data = [data]
# ---------- end python_3 ----------
python_4 = GhPythonScript(DATA=py.DATA, name=name)  # -> filepath; disabled
# ---------- python_4: Python ----------
import os

filename = name + ".json"
filepath = os.path.join(DATA, filename)
print filepath
# ---------- end python_4 ----------
toggle = BooleanToggle(True)  # disabled
to_json = ToJSON(data=python_3, filepath=python_4, pretty=toggle)  # -> json; inputs pretty: Boolean; disabled
#   port data: COMPAS data objects to serialize.
#   port filepath: File path where to store the JSON file. If empty, it will not store to disk but instead return the JSON string.
#   port pretty: If True, JSON data will be formatted with indentation and key sorting.
#   port json: JSON file path or JSON string.
# ---------- to_json: Python ----------
"""
Serializes COMPAS objects to JSON.
"""
from ghpythonlib.componentbase import executingcomponent as component

import compas


class CompasInfo(component):
    def RunScript(self, data, filepath, pretty):
        json = filepath

        if filepath:
            compas.json_dump(data, filepath, pretty)
        else:
            json = compas.json_dumps(data, pretty)

        return json
# ---------- end to_json ----------

# ----
# Visualisation
number_slider_4 = Slider(0.008, range=0..0.01)  # disabled
python_5 = GhPythonScript(points3d=points3d, gradients=gradient, scale=number_slider_4)  # -> crv, params, radii; inputs points3d: list, gradients: list; disabled
# ---------- python_5: Python ----------
import Rhino.Geometry as rg
import scriptcontext


crv = rg.Curve.CreateControlPointCurve(points3d)
params = [crv.ClosestPoint(pt)[1] for pt in points3d]
radii = [r*scale for r in gradients]
# ---------- end python_5 ----------
swatch_2 = ColourSwatch(SwatchColor=RGB(0, 255, 123))  # disabled
vpipe_2 = PipeVariable(Curve=python_5.crv, Parameters=python_5.params, Radii=python_5.radii, Caps=0)  # disabled
preview_5 = CustomPreview(Geometry=vpipe_2, Material=swatch_2)  # disabled

# ----
# Export for view
# 4. Press data dam to convert to mesh and export for html viewer
dam_2 = DataDam(DataA=vpipe_2, BufferDelay=10000000, BufferMode=0)  # disabled
button = Button()  # disabled
mesh = MeshBrep(
    Brep=dam_2,
    Settings={GridMaxCount=0, GridMinCount=16, JaggedSeams=False, MaxEdgeLength=0, MinEdgeLength=0.0001, MinTolerance=0, Refine=True, RefineAngle=0, RelativeTolerance=0.65, SimplePlanes=True, Tolerance=0})  # disabled

py_4 = GhPythonScript(M=mesh)  # -> meshes; inputs M: list; disabled
# ---------- py_4: Python ----------
from workshop_sjsu.glb_viewer import transform_and_process_meshes_for_glb

meshes = transform_and_process_meshes_for_glb(M)
# ---------- end py_4 ----------

python_6 = GhPythonScript(meshes=py_4, name=name, color=swatch_2, write=button)  # -> out; inputs meshes: list; disabled
# ---------- python_6: Python ----------
from workshop_sjsu.glb_viewer import create_glb_viewer
from compas.utilities import color_to_rgb

color = color_to_rgb([color.R, color.G, color.B], normalize=True)

if write:
    create_glb_viewer(name, meshes, color)
# ---------- end python_6 ----------
# Run localhost.py and open
# 
# http://127.0.0.1:8000/example04.html
# in your browser
panel_4 = Panel(python_6)  # disabled
