# Grasshopper definition setup.ghx (Grasshopper 1.0.7)

reload = Button()
_360_camera = Geometry(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)

# ----
# Robot
load = Button()
python = GhPythonScript(load=load)  # -> robot
# ---------- python: Python ----------
from scriptcontext import sticky as st

import compas

compas.PRECISION = '12f'

from compas_fab.robots.ur5 import Robot
from compas_ghpython.artists import RobotModelArtist


# Store robot in component-based key
robot_key = 'robot_{}'.format(str(ghenv.Component.InstanceGuid))

if robot_key not in st:
    st[robot_key] = None
    

if load:
    ur5 = Robot(load_geometry=True)
    ur5.artist = RobotModelArtist(ur5.model)
    st[robot_key] = ur5

robot = st[robot_key]
# ---------- end python ----------
robot = Data(python)

# ----
# Tool
attach = BooleanToggle(True)
z_offset = Slider(0.07, range=-0.1..0.2)
brep = Brep(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)
mesh = Mesh(brep)
attach_tool = GhPythonScript(robot=robot, mesh=mesh, attached=attach, z_offset=z_offset, name="light_pen")  # -> frame
# ---------- attach_tool: Python ----------
import os
from compas.geometry import Frame
from compas.datastructures import Mesh
from compas_fab.robots import PlanningScene
from compas_fab.robots import Tool
from compas_ghpython.artists import MeshArtist

from compas_rhino.geometry import RhinoMesh

# create tool from mesh and frame
mesh = RhinoMesh.from_geometry(mesh).to_compas()
frame = Frame([z_offset, 0, 0], [0, 0, 1], [0, 1, 0])
tool = Tool(mesh, frame, name=name)

print frame, name

print tool
#tool_at_origin = MeshArtist(mesh).draw()

if robot:
    if attached:
        robot.attach_tool(tool)
    else:
        if robot.attached_tool:
            robot.detach_tool()
# ---------- end attach_tool ----------

py = PythonScript(reload=reload)
# ---------- py: Python ----------
if reload:
    from compas_ghpython import unload_modules
    unload_modules('compas')
    unload_modules('workshop_sjsu')
    unload_modules('compas_fab')
# ---------- end py ----------
vec = Vector(Vector(0, 0, 0.1))
geo = Geometry([Line((27.37796388, 0.5367892955, 0), (27.63477613, 2.289597485, 0)), Line((27.63477613, 2.289597485, 0), (29.33600454, 1.830921456, 0)), Line((29.33600454, 1.830921456, 0), (30.06502018, 3.437972606, 0)), Line((30.06502018, 3.437972606, 0), (28.48304606, 4.224271738, 0)), Line((28.48304606, 4.224271738, 0), (26.72203787, 4.088580826, 0)), Line((26.72203787, 4.088580826, 0), (26.52752794, 5.83958508, 0))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])
pipe = Pipe(Curve=geo, Radius=Slider(0.1, range=0..0.1), Caps=0)
vec_2 = Vector(Vector(0.5, 0, 0.1))
scale = Scale(Geometry=geo, Center=Point(0, 0, 0), Factor=Slider(0.006, range=0..0.01))  # -> Geometry, Transform
preview = CustomPreview(Geometry=pipe, Material=ColourSwatch(SwatchColor=RGB(112, 255, 210)))
sphere = Sphere(R=Slider(0.25, range=0..1), T=vec)

# ---- group: forward kinematics
# Configuration
a1 = Slider(-24, range=-360..360)
a2 = Slider(-80, range=-360..360)
a3 = Slider(92, range=-360..360)
a4 = Slider(-92, range=-360..360)
a5 = Slider(-83, range=-360..360)
a6 = Slider(0, range=-360..360)
forward_kinematics = PythonScript(robot=robot, a1=a1, a2=a2, a3=a3, a4=a4, a5=a5, a6=a6)  # -> configuration
# ---------- forward_kinematics: Python ----------
import math
from compas.robots import Configuration

if robot:
    joint_values = [a1, a2, a3, a4, a5, a6]
    joint_names = robot.get_configurable_joint_names()
    configuration = Configuration.from_revolute_values([math.radians(a) for a in joint_values])
# ---------- end forward_kinematics ----------

# ----
python_2 = GhPythonScript(
    sphere=sphere,
    lines=scale.Geometry,
    mult=Slider(7, range=0..10),
    move_u=Slider(0, range=0..100),
    move_v=Slider(0, range=0..100))  # -> out, L, a; inputs sphere: Surface, lines: list
# ---------- python_2: Python ----------
print sphere.Domain(0)
print sphere.Domain(1)
import Rhino.Geometry as rg

L = []

for line in lines:
    p0 = line.From
    p1 = line.To
    
    u, v = move_u + p0.X * mult, move_v + p0.Y * mult
    p0 = sphere.PointAt(u, v)
    u, v = move_u + p1.X * mult, move_v + p1.Y * mult
    p1 = sphere.PointAt(u, v)
    L.append(rg.Line(p0, p1))
# ---------- end python_2 ----------
number_slider = Slider(0.1, range=0..0.1)
end = EndPoints(Curve=python_2.L)  # -> Start, End
nurbs = NurbsCurve(Vertices=end.Start, Degree=3, Periodic=False)  # -> Curve, Length, Domain
pipe_2 = Pipe(Curve=python_2.L, Radius=Slider(0.001, range=0..0.001), Caps=0)
brep_cp = BrepClosestPoint(Point=end.Start, Brep=sphere)  # -> Point, Normal, Distance
python_3 = GhPythonScript(p=brep_cp.Point, n=brep_cp.Normal)  # -> frame, plane
# ---------- python_3: Python ----------
from compas.geometry import Frame
import Rhino.Geometry as rg

plane = rg.Plane(p, n)
#plane = rg.Plane(plane.Origin, plane.ZAxis, plane.XAxis)
plane = rg.Plane(plane.Origin, plane.XAxis, plane.YAxis)
frame = Frame(plane.Origin, plane.XAxis, plane.YAxis)
# ---------- end python_3 ----------
python_4 = GhPythonScript(idx=Slider(2, range=0..10))  # -> out, c; inputs idx: Int32
# ---------- python_4: Python ----------
from compas.robots import Configuration

c1 = Configuration((-0.091, 4.918, 2.179, 1.934, 4.795, -0.262), (0, 0, 0, 0, 0, 0), ('shoulder_pan_joint', 'shoulder_lift_joint', 'elbow_joint', 'wrist_1_joint', 'wrist_2_joint', 'wrist_3_joint'))
c2 = Configuration((0.024, 6.261, 4.774, 2.710, 1.876, 3.164), (0, 0, 0, 0, 0, 0), ('shoulder_pan_joint', 'shoulder_lift_joint', 'elbow_joint', 'wrist_1_joint', 'wrist_2_joint', 'wrist_3_joint'))
c3 = Configuration((0.024, 4.430, 2.057, 4.118, 4.407, 0.023), (0, 0, 0, 0, 0, 0), ('shoulder_pan_joint', 'shoulder_lift_joint', 'elbow_joint', 'wrist_1_joint', 'wrist_2_joint', 'wrist_3_joint'))


L = [c1, c2, c3]

c = L[idx]
# ---------- end python_4 ----------
preview_2 = CustomPreview(Geometry=pipe_2, Material=ColourSwatch(SwatchColor=RGB(112, 255, 210)))
item = ListItem(List=python_3.frame, Index=Slider(100, range=0..100), Wrap=True)
python_5 = GhPythonScript(robot=robot, frame=item)  # -> configurations
# ---------- python_5: Python ----------
from compas_fab.backends.kinematics import UR5KinematicsSolver

kinematics = UR5KinematicsSolver(robot)

configurations = kinematics.inverse_kinematics(frame)
# ---------- end python_5 ----------
item_2 = ListItem(List=python_5, Index=Slider(2, range=0..10), Wrap=True)
python_6 = GhPythonScript(frames=python_3.frame)  # -> out, a; inputs frames: list
# ---------- python_6: Python ----------
print frames[100:105]
# ---------- end python_6 ----------

# ----
# Visualisation
show_end_effector_frame = BooleanToggle(False)
show_base_frame = BooleanToggle(False)
show_collision = BooleanToggle(False)
show_frames = BooleanToggle(False)
show_visual = BooleanToggle(True)
show_acm = BooleanToggle(True)
robot_visualize = RobotVisualize(
    robot=robot,
    configuration=forward_kinematics,
    show_visual=show_visual,
    show_collision=show_collision,
    show_frames=show_frames,
    show_base_frame=show_base_frame,
    show_end_effector_frame=show_end_effector_frame,
    show_acm=show_acm)  # -> visual, collision, attached_meshes, frames, base_frame, ee_frame; inputs attached_collision_meshes: list, show_visual: Boolean, show_collision: Boolean, show_frames: Boolean, show_base_frame: Boolean, show_end_effector_frame: Boolean, show_acm: Boolean
#   port group: The planning group used for end-effector and base visualization.
#   port configuration: The robot's full configuration.
#   port attached_collision_meshes: A list of attached collision meshes.
#   port show_visual: Whether or not to show the robot's visual meshes.
#   port show_collision: Whether or not to show the robot's collision meshes.
#   port show_frames: Whether or not to show the robot's joint frames.
#   port show_base_frame: Whether or not to show the robot's base frame.
#   port show_end_effector_frame: Whether or not to show the robot's end-effector frame.
#   port show_acm: Whether or not to show the attached collision meshes (if any).
#   port visual: The robot's visual Rhino meshes (if any).
#   port collision: The robot's collision Rhino meshes (if any).
#   port attached_meshes: The attached collision Rhino meshes (if any).
#   port frames: The robot's joint frames as Rhino planes (if any).
#   port base_frame: The robot's base frame as a Rhino plane (if any).
#   port ee_frame: The robot's end-effector frame as a Rhino plane (if any).
# ---------- robot_visualize: Python ----------
"""
Visualizes the robot.

COMPAS FAB v0.19.1
"""
from compas.geometry import Frame
from compas.geometry import Transformation
from compas_ghpython.artists import FrameArtist
from compas_ghpython.artists import MeshArtist
from ghpythonlib.componentbase import executingcomponent as component


class RobotVisualize(component):
    def RunScript(self, robot, group, configuration, attached_collision_meshes, show_visual, show_collision,
                  show_frames, show_base_frame, show_end_effector_frame, show_acm):

        visual = None
        collision = None
        attached_meshes = None
        frames = None
        base_frame = None
        ee_frame = None

        if robot:
            show_visual = True if show_visual is None else show_visual
            configuration = configuration or robot.zero_configuration()

            robot.update(configuration, visual=show_visual, collision=show_collision)
            compas_frames = robot.transformed_frames(configuration, group)

            if show_visual:
                visual = robot.artist.draw_visual()

            if show_collision:
                collision = robot.artist.draw_collision()

            if show_base_frame:
                base_compas_frame = compas_frames[0]
                artist = FrameArtist(base_compas_frame)
                base_frame = artist.draw()

            if show_end_effector_frame:
                ee_compas_frame = robot.forward_kinematics(configuration, group, options=dict(solver='model'))
                artist = FrameArtist(ee_compas_frame)
                ee_frame = artist.draw()

            if show_frames:
                frames = []
                for compas_frame in compas_frames[1:]:
                    artist = FrameArtist(compas_frame)
                    frame = artist.draw()
                    frames.append(frame)

            if show_acm:
                attached_meshes = []
                for acm in attached_collision_meshes:
                    frame = robot.forward_kinematics(configuration, options=dict(solver='model', link_name=acm.link_name))
                    T = Transformation.from_frame_to_frame(Frame.worldXY(), frame)
                    mesh = acm.collision_mesh.mesh.transformed(T)
                    attached_meshes.append(MeshArtist(mesh).draw())

        return (visual, collision, attached_meshes, frames, base_frame, ee_frame)
# ---------- end robot_visualize ----------
geo_2 = Geometry(robot_visualize.collision)
geo_3 = Geometry(robot_visualize.visual)
draw = GhPythonScript(
    frames=flatten([robot_visualize.frames, robot_visualize.base_frame, robot_visualize.ee_frame]),
    scale=Slider(0.1, range=0..1))  # -> P, V, C, W; inputs frames: list
# ---------- draw: Python ----------
from System.Drawing import Color
from compas_ghpython.utilities import draw_frame

red = Color.FromArgb(255, 0, 0)
green = Color.FromArgb(0, 255, 0)
blue = Color.FromArgb(0, 0, 255)

P = []
V = []
C = []

scale = float(scale)

for frame in frames:
    if not frame:
        continue
    plane = frame
    P += [plane.Origin] * 3
    V.append(plane.XAxis * scale)
    V.append(plane.YAxis * scale)
    V.append(plane.ZAxis * scale)
    C += [red, green, blue]

W = 3
# ---------- end draw ----------
vdisex = VectorDisplayEx(Point=draw.P, Vector=draw.V, Colour=draw.C, Width=draw.W)

# ==== cluster Sphere
T = ClusterInput()
R = ClusterInput()
sph = Sphere(Base=PlaneXY(0, 0, 0), Radius=R)
rad = Radians(Degrees=Slider(90, range=0..100))
xz = XZPlane(Origin=Point(0, 0, 0))
rotate = Rotate(Geometry=sph, Angle=rad, Plane=xz)  # -> Geometry, Transform
move = Move(Geometry=rotate.Geometry, Motion=T)  # -> Geometry, Transform
G = ClusterOutput(move.Geometry)
